# Grasshopper definition FlatNozzle_adaptive_rotation.gh (Grasshopper 1.0.7)
# plug-ins: Pufferfish

crv = Curve(<curve referenced from the Rhino model>)
number_slider = Slider(30, range=0..100)
brep = Brep(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)
crv_2 = Curve(crv)
volume = Volume(Geometry=brep)  # -> Volume, Centroid
mesh = Mesh(brep)

cp = ControlPoints(Curve=crv_2)  # -> Points, Weights, Knots
explode = Explode(Curve=crv_2, Recursive=True)  # -> Segments, Vertices
panel = Panel(cp.Points)
len = Length(Curve=explode.Segments)
ins = InsertItems(List=len, Item="0", Indices="0", Wrap=True)
ma = MassAddition(Input=flatten(ins))  # -> Result, PartialResults
pdecon = Deconstruct(Point=flatten(panel))  # -> XComponent, YComponent, ZComponent
multiplication = Multiplication(A="20", B="60")
panel_2 = Panel(ma.PartialResults)
multiplication_2 = Multiplication(A=panel_2, B="100")
claycura_start = Panel("""M109 S20.000000
;Sliced at: Tue 15-12-2020 14:14:58
;Basic settings: Layer height: 2 Walls: 4 Fill: 0
;Print time: 3 hours 20 minutes
;Filament used: 18.308m 1783.0g
;Filament cost: 274.62
;M190 S70 ;Uncomment to add your own bed temperature line
;M109 S20 ;Uncomment to add your own temperature line
G21        ;metric values
G90        ;absolute positioning
M82        ;set extruder to absolute mode
M107       ;start with the fan off
G1 Z2 F9000 ;move the platform down 15mm
G92 E0                  ;zero the extruded length
G1 F200 E3              ;extrude 3mm of feed stock
G92 E0                  ;zero the extruded length again
G1 F9000
;Put printing message on LCD screen
M117 Printing...""")
claycura_end = Panel("""M107
G0 F9000 X179.552 Y103.364 Z286.250
;End GCode
M104 S0                     ;extruder heater off
M140 S0                     ;heated bed heater off (if you have it)
G91                                    ;relative positioning
G1 E-1 F300                            ;retract the filament a bit before lifting the nozzle, to release some of the pressure
G1 Z+0.5 E-5  ;move Z up a bit and retract filament even more
M84                         ;steppers off
G90                         ;absolute positioning
;CURA_PROFILE_STRING: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""")
int = Integer(multiplication_2)
division = Division(A=int, B="100")
concat = Concatenate(
    FragmentA="G1",
    FragmentB=" F",
    FragmentC=multiplication,
    FragmentD=" X",
    FragmentE=pdecon.XComponent,
    FragmentF=" Y",
    FragmentG=pdecon.YComponent,
    FragmentH=" Z",
    FragmentI=pdecon.ZComponent,
    FragmentJ=" E",
    FragmentK=division)
merge = Merge(Data1=claycura_start, Data2=concat, Data3=claycura_end)
panel_3 = Panel(merge)

hframes = HorizontalFrames(Curve=crv, Count=number_slider)  # -> Frames, Parameters
rectangle = Rectangle(Plane=hframes.Frames, XSize=Domain(-1, 1), YSize=Domain(-2, 2), Radius=0)  # -> Rectangle, Length

# ---- group: Tan display
divide = DivideCurve(Curve=crv, Count=number_slider, Kinks=False)  # -> Points, Tangents, Parameters
amp = Amplitude(Vector=divide.Tangents, Amplitude=Slider(6, range=0..100))
vdis = VectorDisplay(Anchor=divide.Points, Vector=amp)

# ----
boundary = BoundarySurfaces(Edges=rectangle.Rectangle)

deplane = DeconstructPlane(Plane=hframes.Frames)  # -> Origin, XAxis, YAxis, ZAxis
vec = VectorXYZ(XComponent=deplane.XAxis, YComponent=0, ZComponent=0)  # -> Vector, Length
amp_2 = Amplitude(Vector=vec.Vector, Amplitude=Slider(5, range=0..100))
vdis_2 = VectorDisplay(Anchor=deplane.Origin, Vector=amp_2)

number_slider_2 = Slider(18, range=0..100)
item = ListItem(List=rectangle.Rectangle, Index=number_slider_2, Wrap=True)
area = Area(Geometry=item)  # -> Area, Centroid
move2pt = MoveToPoint(Geometry=mesh, PointA=volume.Centroid, PointB=area.Centroid)  # -> Moved, Vector, Transform
angle = Angle(VectorA=amp, VectorB=amp_2)  # -> Angle, Reflex
deg = Degrees(Radians=angle.Angle)
tag = TextTag3D(Location=hframes.Frames, Text=deg, Size=1, Colour=ColourSwatch(SwatchColor=RGB(255, 255, 255)), Justification=7)
num = Number()

# ---- group: Ideal Angle
rad = Radians(Degrees=Slider(-15, range=-180..180))
Z = UnitZ(Factor=Slider(12, range=0..100))
move = Move(Geometry=move2pt.Moved, Motion=Z)  # -> Geometry, Transform
item_2 = ListItem(List=rad, Index=number_slider_2, Wrap=True)
rotate = Rotate(Geometry=move.Geometry, Angle=item_2, Plane=area.Centroid)  # -> Geometry, Transform
preview = CustomPreview(
    Geometry=rotate.Geometry,
    Material={diffuse=RGB(221, 160, 221), emission=RGB(66, 48, 66), shine=0.5, specular=RGB(255, 255, 255), transparency=0})

# ----
deg_2 = Degrees(Radians=angle.Angle)
python = GhPythonScript(a=deg_2)  # -> out, angles; inputs a: list
# ---------- python: Python ----------
angles = []

first = True

alpha_p = 0
for idx, val in enumerate(a):
    if first:
        first = False
    else:
        if val > val_p:
            a[idx] = -val
    angles.append(a[idx])
    val_p = a[idx]
# ---------- end python ----------
rad_2 = Radians(Degrees=python.angles)
item_3 = ListItem(List=rad_2, Index=number_slider_2, Wrap=True)

Z_2 = UnitZ(Factor=Slider(12, range=0..100))
move_2 = Move(Geometry=move2pt.Moved, Motion=Z_2)  # -> Geometry, Transform
rotate_2 = Rotate(Geometry=move_2.Geometry, Angle=item_3, Plane=area.Centroid)  # -> Geometry, Transform
preview_2 = CustomPreview(Geometry=rotate_2.Geometry, Material=ColourSwatch(SwatchColor=RGB(157, 26, 186)))

deg_3 = Degrees(Radians=angle.Angle)
interp = InterpolateData(Data=deg_3, Parameter=1, Interpolation=2)
