# Grasshopper definition Nozzles_design.gh (Grasshopper 1.0.7)

cir = Circle(Plane=PlaneXY(0, 0, 0), Radius=Slider(3, range=0..100))
divide = DivideCurve(Curve=cir, Count=Slider(3, range=3..30), Kinks=False)  # -> Points, Tangents, Parameters
toggle = BooleanToggle(True)
pline = PolyLine(Vertices=divide.Points, Closed=toggle)
intcrv = Interpolate(Vertices=divide.Points, Degree=3, Periodic=toggle, KnotStyle=1)  # -> Curve, Length, Domain
fillet = Fillet(Curve=pline, Radius=Slider(0.5, range=0..1))

depth = Slider(1.476, range=0..100)
fillet_2 = Slider(0.3, range=0..1)
polygon = Polygon(Plane=PlaneXY(0, 0, 0), Radius=3, Segments=Slider(10, range=3..10), FilletRadius=0)  # -> Polygon, Length
neg = Negative(Value=depth)
disc = Discontinuity(Curve=polygon.Polygon, Level=1)  # -> Points, Parameters
dispatch = Dispatch(List=disc.Points, DispatchPattern=[True, False])  # -> ListA, ListB
amp = Amplitude(Vector=dispatch.ListA, Amplitude=neg)
move = Move(Geometry=dispatch.ListA, Motion=amp)  # -> Geometry, Transform
weave = Weave(Pattern=[0, 1], Stream0=move.Geometry, Stream1=dispatch.ListB, NullGaps=False)
pline_2 = PolyLine(Vertices=weave, Closed=Toggle(True))
fillet_3 = Fillet(Curve=pline_2, Radius=fillet_2)

# ---- group: Offset
neg_2 = Negative(Value=Slider(0.4, range=0..10))
offset = OffsetCurve(Distance=neg_2, Corners=1)
